vi "index.gviweb"   [G Web Development Software 22.3.0]
panel controls:
  "Part_shape": string
  "Part_size": string
  "Listbox": i32 = -1
panel indicators:
  "Tab": i32
  "Cluster": cluster{"URL Image": string}
  "Error Out": error
  "URL Image": string
  "New Value": string
  "String Constant": string
uses:
  NI::HTTP::GET.gvi
diagram:
  Property Node(instance in=reference to "Listbox", "Items"=["eq", "уц", "уй"])
  s1 = ["init"]  # shift register
  while {
    Delete From Array(inArray=s1, index0=0) -> (outArray=w1, deleted=w2)
    case (w2) {
      frame "Wait_for_event", Default {
        event (timeout = 100) {
          on "Timeout" {
            w3 = w1
            w4 = no error
          }
          on "Part_shape" Value changed {
            Event Data() -> ("New Value"=w5)
            $"New Value" <- w5
            w6 = "load_part_image"  # main_states
            Build Array(w1, w6) -> w3
            w4 = no error
          }
        }
      }
      frame "init" {
        $Tab <- "Task_window"
        Build Array(w1, ["get_parts_list", "get_alloys_list"]) -> w3
        w4 = no error
      }
      frame "load_part_image" {
        $"URL Image" <- "graphic\\Ось.png"
        $"String Constant" <- "graphic\\Ось.png"
        Concatenate Strings("graphic/", $Part_shape, ".png")
        w3 = w1
        w4 = no error
      }
      frame "stop" {
        w3 = w1
        w4 = no error
      }
      frame "get_parts_list" {
        Concatenate Strings("http://desktop-n8eovm3:80/WebUIService/", "Get_parts_list") -> w7
        call "GET.gvi"(url=w7) -> (body=w8, error out=w9)
        Unflatten From Json(JSON string=w8, error in (no error)=w9, path=["Parts_list"], type and defaults=cluster{"String": string, "Value": string}[] []) -> (error out=w10, value=w11)
        for {
          w12 = each element of w11
          Cluster To Array(cluster=w12) -> (array=w14)
          Array Index(array=w14) -> (out0[_]=w15)
          append w15 to w13
        }
        Property Node(instance in=reference to "Part_shape", "Items"=w13, "ItemsAndValues"=w11, "DisabledIndexes"=i32[] [], error in=w10) -> (error out=w16, instance out=w17)
        Close Reference(error in=w16, reference=w17) -> (error out=w4)
        w3 = w1
      }
      frame "get_alloys_list" {
        w3 = w1
        w4 = no error
      }
    }
    next s1 = w3
    stop if FALSE
  }
  $"Error Out" <- w4
